# Dynamo graph Live-NurbsSurface-exchange-from-Grasshopper-to-Rhino.dyn (Dynamo 1.3.2.2480)

# group: 1. Make sure that the port number for incoming data matches the port number in Grasshopper for the outcoming data
code_block = CodeBlock { 4141; }

socketAdapter = CreateAdapterComponent(arg1=code_block)

# group: 2. Set the boolean to true to start live streaming from Grasshopper . Start streaming FIRST from Grasshopper, and then start receiving in Dynamo.
boolean = BoolSelector(true)

pull = PullComponent(socketAdapter, arg3=boolean)
watch = Watch(pull)
