# Dynamo graph ComplexRequests.dyn "ComplexRequestsDynamo" (Dynamo 2.0.2.6826)

# group: Revit adapter
boolean = BoolSelector(false)
revitAdapter = CreateAdapterComponent(active=boolean, SerialisedCaller="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", lacing=Shortest)

# group: Filter structural bars
createType = CreateTypeComponent(lacing=Shortest)
filterByBHoMType = CreateObjectComponent(bHoMType=createType, SerialisedCaller="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", lacing=Shortest)

# group: Filter structural panels
createType_2 = CreateTypeComponent(lacing=Shortest)
filterByBHoMType_2 = CreateObjectComponent(bHoMType=createType_2, SerialisedCaller="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", lacing=Shortest)

# group: Structural parameter filter
code_block = CodeBlock { "Structural"; true; }
filterByParameterBool = CreateObjectComponent(ParameterName=code_block.out0, Value=code_block.out1, SerialisedCaller="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", lacing=Shortest)

# group: Logical statement
logicalOrRequest = CreateObjectComponent(request1=filterByBHoMType, request2=filterByBHoMType_2, SerialisedCaller="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", lacing=Shortest)
logicalAndRequest = CreateObjectComponent(request1=logicalOrRequest, request2=filterByParameterBool, SerialisedCaller="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", lacing=Shortest)

# group: Pull
boolean_2 = BoolSelector(false)
pull = PullComponent(adapter=revitAdapter, request=logicalAndRequest, active=boolean_2, SerialisedCaller="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", lacing=Shortest)  # unwired: pullType

# group: Revit adapter
boolean_3 = BoolSelector(false)
revitAdapter_2 = CreateAdapterComponent(active=boolean_3, SerialisedCaller="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", lacing=Shortest)

# group: Filter plan views
revitViewType = CreateEnumComponent(index=12, SerialisedCaller="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", lacing=Shortest)
filterViewsByType = CreateObjectComponent(RevitViewType=revitViewType, SerialisedCaller="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", lacing=Shortest)

# group: Filter by name prefix
code_block_2 = CodeBlock { "View Name"; }
textComparisonType = CreateEnumComponent(index=4, SerialisedCaller="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", lacing=Shortest)
code_block_3 = CodeBlock { "Structural"; }
filterByParameterText = CreateObjectComponent(ParameterName=code_block_2, TextComparisonType=textComparisonType, Value=code_block_3, SerialisedCaller="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", lacing=Shortest)

# group: Logical and statement
logicalAndRequest_2 = CreateObjectComponent(request1=filterViewsByType, request2=filterByParameterText, SerialisedCaller="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", lacing=Shortest)

# group: Pull views
boolean_4 = BoolSelector(false)
pull_2 = PullComponent(adapter=revitAdapter_2, request=logicalAndRequest_2, active=boolean_4, SerialisedCaller="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", lacing=Shortest)  # unwired: pullType

# group: Revit adapter
boolean_5 = BoolSelector(false)
revitAdapter_3 = CreateAdapterComponent(active=boolean_5, SerialisedCaller="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", lacing=Shortest)

# group: Filter by DB type
code_block_4 = CodeBlock { "Autodesk.Revit.DB.Mechanical.MechanicalSystem"; }
filterByDBTypeName = CreateObjectComponent(TypeName=code_block_4, SerialisedCaller="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", lacing=Shortest)

# group: Pull
boolean_6 = BoolSelector(false)
pull_3 = PullComponent(adapter=revitAdapter_3, request=filterByDBTypeName, active=boolean_6, SerialisedCaller="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", lacing=Shortest)  # unwired: pullType

# group: Revit adapter
boolean_7 = BoolSelector(true)
revitAdapter_4 = CreateAdapterComponent(active=boolean_7, SerialisedCaller="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", lacing=Shortest)

# group: Filter active view
filterActiveView = CreateObjectComponent(lacing=Shortest)

# group: PullPull active view
boolean_8 = BoolSelector(false)
pull_4 = PullComponent(adapter=revitAdapter_4, request=filterActiveView, active=boolean_8, SerialisedCaller="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", lacing=Shortest)  # unwired: pullType

# group: Filter view specific
filterByViewSpecific = CreateObjectComponent(bHoMObject=pull_4, SerialisedCaller="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", lacing=Shortest)

# group: Filter detail items
code_block_5 = CodeBlock { "Detail Items"; }
filterByCategory = CreateObjectComponent(CategoryName=code_block_5, SerialisedCaller="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", lacing=Shortest)

# group: Logical and statement
logicalAndRequest_3 = CreateObjectComponent(request1=filterByViewSpecific, request2=filterByCategory, SerialisedCaller="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", lacing=Shortest)

# group: Pull detail items that belong to a view
boolean_9 = BoolSelector(false)
pull_5 = PullComponent(adapter=revitAdapter_4, request=logicalAndRequest_3, active=boolean_9, SerialisedCaller="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", lacing=Shortest)  # unwired: pullType

# group: Revit adapter
boolean_10 = BoolSelector(false)
revitAdapter_5 = CreateAdapterComponent(active=boolean_10, SerialisedCaller="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", lacing=Shortest)

# group: Filter family
code_block_6 = CodeBlock { "UB Universal Beams"; }
filterFamilyByName = CreateObjectComponent(FamilyName=code_block_6, SerialisedCaller="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", lacing=Shortest)

# group: Pull UB Beam family
boolean_11 = BoolSelector(false)
pull_6 = PullComponent(adapter=revitAdapter_5, request=filterFamilyByName, active=boolean_11, SerialisedCaller="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", lacing=Shortest)  # unwired: pullType

# group: Filter types of family
filterFamilyTypesOfFamily = CreateObjectComponent(bHoMObject=pull_6, SerialisedCaller="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", lacing=Shortest)

# group: Pull types of a family
boolean_12 = BoolSelector(false)
pull_7 = PullComponent(adapter=revitAdapter_5, request=filterFamilyTypesOfFamily, active=boolean_12, SerialisedCaller="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", lacing=Shortest)  # unwired: pullType

# group: Revit adapter
boolean_13 = BoolSelector(false)
revitAdapter_6 = CreateAdapterComponent(active=boolean_13, SerialisedCaller="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", lacing=Shortest)

# group: Filter elements by family and type
code_block_7 = CodeBlock { "HE wide flange beams"; "HEA 300"; false; }
filterByFamilyAndTypeName = CreateObjectComponent(FamilyName=code_block_7.out0, FamilyTypeName=code_block_7.out1, CaseSensitive=code_block_7.out2, SerialisedCaller="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", lacing=Shortest)

# group: Pull HEA 300 elements
boolean_14 = BoolSelector(false)
pull_8 = PullComponent(adapter=revitAdapter_6, request=filterByFamilyAndTypeName, active=boolean_14, SerialisedCaller="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", lacing=Shortest)  # unwired: pullType
