# Dynamo graph PullDisciplines.dyn "pullDisciplinesDynamo" (Dynamo 2.0.2.6826)

# group: Revit adapter
boolean = BoolSelector(false)
revitAdapter = CreateAdapterComponent(active=boolean, SerialisedCaller="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", lacing=Shortest)

# group: Category filter
code_block = CodeBlock { "Walls"; }
filterByCategory = CreateObjectComponent(CategoryName=code_block, SerialisedCaller="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", lacing=Shortest)

# group: Pull physical
boolean_2 = BoolSelector(false)
pull = PullComponent(adapter=revitAdapter, request=filterByCategory, active=boolean_2, SerialisedCaller="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", lacing=Shortest)  # unwired: pullType

# group: Physical discipline
discipline = CreateEnumComponent(index=4, SerialisedCaller="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", lacing=Shortest)
revitPullConfig = CreateObjectComponent(discipline=discipline, SerialisedCaller="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", lacing=Shortest)

# group: Category filter
code_block_2 = CodeBlock { "Walls"; }
filterByCategory_2 = CreateObjectComponent(CategoryName=code_block_2, SerialisedCaller="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", lacing=Shortest)

# group: Pull structural
boolean_3 = BoolSelector(false)
pull_2 = PullComponent(adapter=revitAdapter, request=filterByCategory_2, active=boolean_3, SerialisedCaller="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", lacing=Shortest)  # unwired: pullType

# group: Structural discipline
discipline_2 = CreateEnumComponent(index=2, SerialisedCaller="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", lacing=Shortest)
revitPullConfig_2 = CreateObjectComponent(discipline=discipline_2, SerialisedCaller="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", lacing=Shortest)

# group: Category filter
code_block_3 = CodeBlock { "Walls"; }
filterByCategory_3 = CreateObjectComponent(CategoryName=code_block_3, SerialisedCaller="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", lacing=Shortest)

# group: Pull environmental
boolean_4 = BoolSelector(false)
pull_3 = PullComponent(adapter=revitAdapter, request=filterByCategory_3, active=boolean_4, SerialisedCaller="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", lacing=Shortest)  # unwired: pullType

# group: Environmental discipline
discipline_3 = CreateEnumComponent(index=1, SerialisedCaller="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", lacing=Shortest)
revitPullConfig_3 = CreateObjectComponent(discipline=discipline_3, SerialisedCaller="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", lacing=Shortest)
