# Dynamo graph PullEdges.dyn "PullEdgesDynamo" (Dynamo 2.0.2.6826)

# group: Revit adapter
boolean = BoolSelector(true)
revitAdapter = CreateAdapterComponent(active=boolean, SerialisedCaller="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", lacing=Shortest)

# group: Request
code_block = CodeBlock { "Structural Foundations"; }
filterByCategory = CreateObjectComponent(CategoryName=code_block, SerialisedCaller="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", lacing=Shortest)

# group: Pull edges
code_block_2 = CodeBlock { true; }
revitPullConfig = CreateObjectComponent(pullEdges=code_block_2, SerialisedCaller="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", lacing=Shortest)  # unwired: discipline

# group: Pull
boolean_2 = BoolSelector(false)
pull = PullComponent(adapter=revitAdapter, request=filterByCategory, actionConfig=revitPullConfig, active=boolean_2, SerialisedCaller="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", lacing=Shortest)  # unwired: pullType
