# Dynamo graph PullSelection.dyn (Dynamo 2.0.2.6826)

# group: Revit adapter
boolean = BoolSelector(true)
revitAdapter = CreateAdapterComponent(active=boolean, SerialisedCaller="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", lacing=Shortest)

# group: Selection request
filterBySelection = CreateObjectComponent()

# group: Pull
boolean_2 = BoolSelector(false)
pull = PullComponent(adapter=revitAdapter, request=filterBySelection, active=boolean_2, SerialisedCaller="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", lacing=Shortest)  # unwired: pullType
