# Dynamo graph UpdateParameter.dyn (Dynamo 2.0.2.6826)

# group: Revit adapter
boolean = BoolSelector(false)
revitAdapter = CreateAdapterComponent(active=boolean, SerialisedCaller="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", lacing=Shortest)

# group: Pull selected elements
filterBySelection = CreateObjectComponent()
boolean_2 = BoolSelector(false)
pull = PullComponent(adapter=revitAdapter, request=filterBySelection, active=boolean_2, SerialisedCaller="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", lacing=Shortest)  # unwired: pullType

# group: Set property
code_block = CodeBlock { "Comments"; "Hello World"; }
setRevitParameter = ModifyComponent(bHoMObject=pull, paramName=code_block.out0, value=code_block.out1, SerialisedCaller="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")

# group: Update element
pushType = CreateEnumComponent(index=3, SerialisedCaller="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", lacing=Shortest)
boolean_3 = BoolSelector(false)
push = PushComponent(adapter=revitAdapter, objects=setRevitParameter, pushType=pushType, active=boolean_3, SerialisedCaller="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", lacing=Shortest)
