# Grasshopper definition PullDisciplines.gh (Grasshopper 0.9.76)
# plug-ins: BH.UI.Grasshopper

# ---- group: Revit adapter
revitadapter = RevitAdapter(Active=Toggle(False), Component="{ ..ctor")

# ---- group: Environmental discipline
discipline = Discipline(
    {"Undefined": 0, "Environmental": 1, "Structural": 2, "Architecture": 3, "Physical": 4}, selected="Environmental",
    Component="BH.oM.Adapters.Revit.Enums.Discipline",
    Selection=1)
revitpullconfig = RevitPullConfig(
    Discipline=discipline,
    IncludeClosedWorksets=False,
    PullEdges=False,
    IncludeNonVisible=False,
    Component="{ .RevitPullConfig")

# ---- group: Structural discipline
discipline_2 = Discipline(
    {"Undefined": 0, "Environmental": 1, "Structural": 2, "Architecture": 3, "Physical": 4}, selected="Structural",
    Component="BH.oM.Adapters.Revit.Enums.Discipline",
    Selection=2)
revitpullconfig_2 = RevitPullConfig(
    Discipline=discipline_2,
    IncludeClosedWorksets=False,
    PullEdges=False,
    IncludeNonVisible=False,
    Component="{ .RevitPullConfig")

# ---- group: Physical discipline
discipline_3 = Discipline(
    {"Undefined": 0, "Environmental": 1, "Structural": 2, "Architecture": 3, "Physical": 4}, selected="Physical",
    Component="BH.oM.Adapters.Revit.Enums.Discipline",
    Selection=4)
revitpullconfig_3 = RevitPullConfig(
    Discipline=discipline_3,
    IncludeClosedWorksets=False,
    PullEdges=False,
    IncludeNonVisible=False,
    Component="{ .RevitPullConfig")

# ---- group: Category filter
# ENVIRONMENTAL
panel = Panel("Walls")
filterbycategory = FilterByCategory(CategoryName=panel, CaseSensitive=True, Component="BH.oM.Adapters.Revit.Requests.FilterByCategory")

# STRUCTURAL
panel_2 = Panel("Walls")
filterbycategory_2 = FilterByCategory(CategoryName=panel_2, CaseSensitive=True, Component="BH.oM.Adapters.Revit.Requests.FilterByCategory")

# PHYSICAL
panel_3 = Panel("Walls")
filterbycategory_3 = FilterByCategory(CategoryName=panel_3, CaseSensitive=True, Component="BH.oM.Adapters.Revit.Requests.FilterByCategory")

# ---- group: Pull environmental
pull = Pull(Adapter=revitadapter, Request=filterbycategory, PullType=revitpullconfig, Active=Toggle(False), Component="{ .Pull")

# ---- group: Pull structural
pull_2 = Pull(Adapter=revitadapter, Request=filterbycategory_2, PullType=revitpullconfig_2, Active=Toggle(False), Component="{ .Pull")

# ---- group: Pull physical
pull_3 = Pull(Adapter=revitadapter, Request=filterbycategory_3, PullType=revitpullconfig_3, Active=Toggle(False), Component="{ .Pull")
