# Grasshopper definition PullRepresentations.gh (Grasshopper 0.9.76)
# plug-ins: BH.UI.Grasshopper

# ---- group: Pull config
detaillevel = DetailLevel({"Coarse": 0, "Medium": 1, "Fine": 2}, selected="Fine", Component="BH.oM.Adapters.Revit.Enums.DetailLevel", Selection=2)
pullrepresentationconfig = PullRepresentationConfig(
    PullRenderMesh=Toggle(True),
    DetailLevel=detaillevel,
    IncludeNonVisible=Toggle(False),
    Component="BH.oM.Adapters.Revit.PullRepresentationConfig")
revitpullconfig = RevitPullConfig(
    Discipline="{ \"_t\" : \"System.Enum\", \"TypeName\" : { \"_t\" : \"System.Type\", \"Name\" : \"BH.oM.Adapters.Revit.Enums.Discipline\" }, \"Value\" : \"Undefined\" }",
    IncludeClosedWorksets=False,
    RepresentationConfig=pullrepresentationconfig,
    Component="{ .RevitPullConfig")

# ---- group: Revit adapter
revitadapter = RevitAdapter(Active=Toggle(False), Component="{ ..ctor")

# ---- group: Selection request
filterbyselection = FilterBySelection(Component="{ .FilterBySelection")

# ---- group: Pull
pull = Pull(
    Adapter=revitadapter,
    Request=filterbyselection,
    PullType="{ \"_t\" : \"System.Enum\", \"TypeName\" : { \"_t\" : \"System.Type\", \"Name\" : \"BH.oM.Adapter.PullType\" }, \"Value\" : \"AdapterDefault\" }",
    ActionConfig=revitpullconfig,
    Active=Toggle(False),
    Component="{ .Pull")

# ---- group: RenderMesh
getproperty = GetProperty(Obj=pull, PropName="RenderMesh", Component="{ .GetProperty")

# ---- group: Coloured preview
explode = Explode(Object=getproperty, Component="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")  # -> Vertices, Faces
item = ListItem(List=explode.Vertices, Index=0, Wrap=True)
explode_2 = Explode(Object=item, Component="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")  # -> Point, flatten(Color)
getproperty_2 = GetProperty(Obj=explode_2.Color, PropName="R", Component="{ .GetProperty")
getproperty_3 = GetProperty(Obj=explode_2.Color, PropName="A", Component="{ .GetProperty")
getproperty_4 = GetProperty(Obj=explode_2.Color, PropName="G", Component="{ .GetProperty")
getproperty_5 = GetProperty(Obj=explode_2.Color, PropName="B", Component="{ .GetProperty")
conmesh = ConstructMesh(Vertices=explode.Vertices, Faces=explode.Faces)
mesh = Mesh(flatten(conmesh))
rgb = ColourRGB(Alpha=getproperty_3, Red=getproperty_2, Green=getproperty_4, Blue=getproperty_5)
preview = CustomPreview(Geometry=mesh, Shader=rgb)
