# Grasshopper definition Pull Revit - Push JSON.gh (Grasshopper 0.9.76)
# plug-ins: BH.UI.Grasshopper

toggle = BooleanToggle(True)

filterrequest = FilterRequest(Type="BH.oM.Environment.Elements.Building", Component="{ .FilterRequest")

revitadapter = RevitAdapter(Active=toggle, Component="{ ..ctor")
pull = Pull(Adapter=revitadapter, Query=filterrequest, Active=toggle, Component="{ .Pull")

buildings = Buildings(BhomObjects=pull, Component="{ .Buildings")
spaces = Spaces(BhomObjects=pull, Component="{ .Spaces")
levels = Levels(Objects=pull, Component="{ .Levels")
panels = Panels(Objects=pull, Component="{ .Panels")

tospaces = ToSpaces(Panels=panels, Component="{ .ToSpaces")
daylightspaceperimeter = DaylightSpacePerimeter(PanelsAsSpaces=tospaces, Component="{ .DaylightSpacePerimeter")
polyline = Polyline(Panel=tospaces, Component="{ .Polyline")
fileadapter = FileAdapter(Folder="C:\Users\mdengusi\Desktop\SAM_Bath\2019-07-04 BHoMtest", FileName="export1.json", Component="{ ..ctor")
panel = Panel(daylightspaceperimeter)
push = Push(Adapter=fileadapter, Objects=tospaces, Active=Toggle(True), Component="{ .Push")  # -> Objects, Success
panel_2 = Panel(push.Success)
