# Grasshopper definition AssignTags.gh (Grasshopper 0.9.76)
# plug-ins: Alligator

# ----
# Create Adapter Here
# File Path to reference model file
# Plug structural adapter in to this component.
path = FilePath("C:\Users\pnugent\Desktop\wgsdgh.mdl")
bhom = BHoMObject()

bhom_2 = BHoMObject(["{ \"_t\" : \"BH.oM.Structure.Elements.Node\", \"BHoM_Guid\" : \"be05b7e3-fa88-42bc-9a5a-c902c1ad715c\", \"Name\" : \"\", \"Tags\" : [\"Sin_Curve\", \"0 to 3*pi\"], \"CustomData\" : { }, \"Position\" : { \"_t\" : \"BH.oM.Geometry.Point\", \"X\" : 0.0, \"Y\" : 85.425527846168293, \"Z\" : -1.57837487694592 }, \"Constraint\" : null }", "{ \"_t\" : \"BH.oM.Structure.Elements.Node\", \"BHoM_Guid\" : \"5d784bc1-0015-4d27-a3ad-ac49b7ead5ae\", \"Name\" : \"\", \"Tags\" : [\"Sin_Curve\", \"0 to 3*pi\"], \"CustomData\" : { }, \"Position\" : { \"_t\" : \"BH.oM.Geometry.Point\", \"X\" : 0.0, \"Y\" : 86.137494868873702, \"Z\" : 0.43886502071964001 }, \"Constraint\" : null }", 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])
panel = Panel("""Steel Elements
Group_1
Test_Group""")
txt = Text(panel)

# ----
# Assign Tags
panel_2 = Panel("Tags")
propertyvalue = PropertyValue(Obj=bhom_2, PropName=panel_2, Value=txt, Component="{ .PropertyValue")

bhom_3 = BHoMObject(propertyvalue)
push = Push(Adapter=bhom, Objects=bhom_3, Active=Toggle(False), Component="{ .Push")  # -> Objects, Success
