# Grasshopper definition CreateBars.gh (Grasshopper 0.9.76)
# plug-ins: BH.UI.Grasshopper

# ----
# Adapter
path = FilePath()
bhom = BHoMObject()

# ----
# Create BHoM Element
line = Line([Line((0, -0.09581336744, 0.5748802047), (0, -0.09581336744, 4.790668372)), Line((0, -0.09581336744, 4.790668372), (0, -0.09581336744, 12.0724843)), Line((0, -0.09581336744, 4.790668372), (0, 3.73672133, 4.790668372)), Line((0, 3.73672133, 4.790668372), (0, 3.73672133, -0.09581336744)), Line((0, 5.365548577, 2.970214391), (0, 8.431576335, 2.970214391)), Line((0, 8.431576335, 2.970214391), (0, 8.335762968, 4.599041637))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])
bar = Bar(
    Line=line,
    OrientationAngle=0,
    FeaType="{ \"_t\" : \"System.Enum\", \"TypeName\" : { \"_t\" : \"System.Type\", \"Name\" : \"BH.oM.Structure.Elements.BarFEAType\" }, \"Value\" : \"Flexural\" }",
    Component="{ .Bar")

# ----
# Push
toggle = BooleanToggle(False)
bhom_2 = BHoMObject(bar)
push = Push(Adapter=bhom, Objects=bhom_2, Active=toggle, Component="{ .Push")  # -> Objects, Success
