# Grasshopper definition CreateFEMesh.gh (Grasshopper 0.9.76)
# plug-ins: BH.UI.Grasshopper

# ----
# Adapter
path = FilePath()
bhom = BHoMObject()

mesh = Mesh(flatten(Tree({0;0}: [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], {0;1}: [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], {0;2}: [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], {0;3}: [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], {0;4}: [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], {0;5}: [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]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)))

# ----
# Create BHoM Object
loadingpanelproperty = LoadingPanelProperty(
    SupportCondition="{ \"_t\" : \"System.Enum\", \"TypeName\" : { \"_t\" : \"System.Type\", \"Name\" : \"BH.oM.Structure.Properties.Surface.LoadPanelSupportConditions\" }, \"Value\" : \"AllSides\" }",
    ReferenceEdge=1,
    Component="{ .LoadingPanelProperty")
femesh = FEMesh(Mesh=mesh, Property=loadingpanelproperty, Component="{ .FEMesh")

# ----
# Push
# Not all structural analysis softwares have an object type coresponding to FEMesh. Please see the wiki page for the specific toolkit for more information
toggle = BooleanToggle(True)
bhom_2 = BHoMObject(femesh)
push = Push(Adapter=bhom, Objects=bhom_2, Active=toggle, Component="{ .Push")  # -> Objects, Success
