# Grasshopper definition CreateNodes.gh (Grasshopper 0.9.76)
# plug-ins: BH.UI.Grasshopper

# ----
# Adapter
path = FilePath()
bhom = BHoMObject()

pt = Point([Point(0, 48.87958545, 15.08731906), Point(0, 51.07010597, 15.08731906), Point(0, 53.84476529, 15.08731906), Point(0, 54.7209735, 13.91904145), Point(0, 53.69873059, 12.02059033), Point(0, 52.82252238, 10.12213922)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])

# ----
# Create BHoM Element
node = Node(Position=pt, Component="{ .Node")

# ----
# Push
toggle = BooleanToggle(False)
bhom_2 = BHoMObject(node)
push = Push(Adapter=bhom, Objects=bhom_2, Active=toggle, Component="{ .Push")  # -> Objects, Success
