# Grasshopper definition CreateAreaTemperatureLoad.gh (Grasshopper 0.9.76)
# plug-ins: BH.UI.Grasshopper

# ----
# Adapter
path = FilePath()
bhom = BHoMObject()

# ----
# Create Loadcase
number_slider = Slider(1, range=0..10)
loadcase = Loadcase(
    Name="Loadcase1",
    Number=number_slider,
    Nature="{ \"_t\" : \"System.Enum\", \"TypeName\" : { \"_t\" : \"System.Type\", \"Name\" : \"BH.oM.Structure.Loads.LoadNature\" }, \"Value\" : \"Other\" }",
    Component="{ .Loadcase")

# ----
# Push
toggle = BooleanToggle(False)
bhom_2 = BHoMObject([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])
push = Push(Adapter=bhom, Objects=bhom_2, Active=toggle, Component="{ .Push")  # -> Objects, Success

# ----
# Create Area Temperature Loads
number_slider_2 = Slider(8, range=0..10)
bhom_3 = BHoMObject(loadcase)
bhom_4 = BHoMObject(push.Objects)
areatemperatureload = AreaTemperatureLoad(
    Loadcase=bhom_3,
    T=number_slider_2,
    Objects=bhom_4,
    Axis="{ \"_t\" : \"System.Enum\", \"TypeName\" : { \"_t\" : \"System.Type\", \"Name\" : \"BH.oM.Structure.Loads.LoadAxis\" }, \"Value\" : \"Global\" }",
    Projected=False,
    Name="Area Temp Load",
    Component="{ .AreaTemperatureLoad")

# ----
# Push
bhom_5 = BHoMObject(areatemperatureload)
push_2 = Push(Adapter=bhom, Objects=bhom_5, Active=push.Success, Component="{ .Push")  # -> Objects, Success
