# Grasshopper definition CreateAreaUniformlyDistributedLoads.gh (Grasshopper 0.9.76)
# plug-ins: Alligator

# ----
# Create Adapter Here
# File Path to reference model file
# Plug structural adapter in to this component.
path = FilePath("C:\Users\pnugent\Desktop\wgsdgh.mdl")
bhom = BHoMObject()

# ----
# Push Planar Panels
number_slider = Slider(1, range=0..10)
# Create Loadcase
panel = Panel("Loadcase1")
loadcase = Loadcase(
    Name=panel,
    Number=number_slider,
    Nature="{ \"_t\" : \"System.Enum\", \"TypeName\" : { \"_t\" : \"System.Type\", \"Name\" : \"BH.oM.Structure.Loads.LoadNature\" }, \"Value\" : \"Other\" }",
    Component="{ .Loadcase")

bhom_2 = BHoMObject([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])
push = Push(Adapter=bhom, Objects=bhom_2, Active=Toggle(False), Component="{ .Push")  # -> Objects, Success

# ----
# CreateAreaUniformlyDistributedLoads
number_slider_2 = Slider(6, range=0..10)
vec = VectorXYZ(XComponent=Slider(9, range=0..10), YComponent=Slider(1, range=0..10), ZComponent=number_slider_2)  # -> Vector, Length
loadaxis = LoadAxis(
    {"Global": 0, "Local": 1}, selected="Global",
    TypeName="BH.oM.Structure.Loads.LoadAxis, Structure_oM, Version=1.0.0.0, Culture=neutral, PublicKeyToken=null")

bhom_3 = BHoMObject(loadcase)
vec_2 = Vector(vec.Vector)
areauniformalydistributedload = AreaUniformalyDistributedLoad(
    Loadcase=bhom_3,
    Pressure=vec_2,
    Objects=push.Objects,
    Axis=loadaxis,
    Projected=False,
    Name="Global - Area",
    Component="{ .AreaUniformalyDistributedLoad")
bhom_4 = BHoMObject(areauniformalydistributedload)
push_2 = Push(Adapter=bhom, Objects=bhom_4, Active=push.Objects, Component="{ .Push")  # -> Objects, Success
