# Grasshopper definition CreateBarUniformlyDistributedLoads.gh (Grasshopper 0.9.76)
# plug-ins: BH.UI.Grasshopper

# ----
# Adapter
path = FilePath()
bhom = BHoMObject(m_ForcePreview=False, m_MaxItemsPreview=10000)

# ----
# Create Loadcase
number_slider = Slider(1, range=0..10)
loadcase = Loadcase(
    Name="Loadcase1",
    Number=number_slider,
    Nature="{ \"_t\" : \"System.Enum\", \"TypeName\" : { \"_t\" : \"System.Type\", \"Name\" : \"BH.oM.Structure.Loads.LoadNature\" }, \"Value\" : \"Other\" }",
    Component="{ .Loadcase")

# ----
# Push
bhom_2 = BHoMObject(
    [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],
    m_ForcePreview=False,
    m_MaxItemsPreview=10000)
push = Push(Adapter=bhom, Objects=bhom_2, Active=Toggle(False), Component="{ .Push")  # -> Objects, Success

bhom_3 = BHoMObject(push.Objects, m_ForcePreview=False, m_MaxItemsPreview=10000)
bhom_4 = BHoMObject(loadcase, m_ForcePreview=False, m_MaxItemsPreview=10000)

# ----
# Create BHoM Load
number_slider_2 = Slider(8, range=0..10)
vec = VectorXYZ(XComponent=Slider(2, range=0..10), YComponent=Slider(6, range=0..10), ZComponent=number_slider_2)  # -> Vector, Length
vec_2 = VectorXYZ(XComponent=Slider(5, range=0..10), YComponent=Slider(2, range=0..10), ZComponent=Slider(9, range=0..10))  # -> Vector, Length
loadaxis = LoadAxis(
    {"Global": 0, "Local": 1}, selected="Global",
    TypeName="BH.oM.Structure.Loads.LoadAxis, Structure_oM, Version=2.0.0.0, Culture=neutral, PublicKeyToken=null")
vec_3 = Vector(vec.Vector)
vec_4 = Vector(vec_2.Vector)
baruniformlydistributedload = BarUniformlyDistributedLoad(
    Loadcase=bhom_4,
    Objects=bhom_3,
    Force=vec_3,
    Moment=vec_4,
    Axis=loadaxis,
    Projected=False,
    Name="UniformlyDistributed",
    Component="{ .BarUniformlyDistributedLoad")

# ----
# Push
bhom_5 = BHoMObject(baruniformlydistributedload, m_ForcePreview=False, m_MaxItemsPreview=10000)
push_2 = Push(Adapter=bhom, Objects=bhom_5, Active=push.Success, Component="{ .Push")  # -> Objects, Success
