# Grasshopper definition CreateGravityLoads.gh (Grasshopper 0.9.76)
# plug-ins: BH.UI.Grasshopper

# ----
# Adapter
path = FilePath()
bhom = BHoMObject(m_ForcePreview=False, m_MaxItemsPreview=10000)

# ----
# Create Loadcase
number_slider = Slider(1, range=0..10)
loadcase = Loadcase(
    Name="Loadcase1",
    Number=number_slider,
    Nature="{ \"_t\" : \"System.Enum\", \"TypeName\" : { \"_t\" : \"System.Type\", \"Name\" : \"BH.oM.Structure.Loads.LoadNature\" }, \"Value\" : \"Other\" }",
    Component="{ .Loadcase")

# ----
# Push
toggle = BooleanToggle(False)
bhom_2 = BHoMObject(
    [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],
    m_ForcePreview=False,
    m_MaxItemsPreview=10000)
push = Push(Adapter=bhom, Objects=bhom_2, Active=toggle, Component="{ .Push")  # -> Objects, Success

bhom_3 = BHoMObject(loadcase, m_ForcePreview=False, m_MaxItemsPreview=10000)
bhom_4 = BHoMObject(push.Objects, m_ForcePreview=False, m_MaxItemsPreview=10000)

# ----
# Create Load
number_slider_2 = Slider(-1, range=-1..1)
vec = VectorXYZ(XComponent=0, YComponent=0, ZComponent=number_slider_2)  # -> Vector, Length
vec_2 = Vector(vec.Vector)
gravityload = GravityLoad(Loadcase=bhom_3, Direction=vec_2, Objects=bhom_4, Name="GravityLoad", Component="{ .GravityLoad")

# ----
# Push
bhom_5 = BHoMObject(gravityload, m_ForcePreview=False, m_MaxItemsPreview=10000)
push_2 = Push(Adapter=bhom, Objects=bhom_5, Active=push.Success, Component="{ .Push")  # -> Objects, Success
