# Grasshopper definition CreateLoadCombinations.gh (Grasshopper 0.9.76)
# plug-ins: BH.UI.Grasshopper

# ----
# Adapter
path = FilePath()
bhom = BHoMObject()

# ----
# Create BHoM Loadcase
number_slider = Slider(1, range=0..10)
txt = Text(["Loadcase1", "Loadcase2", "Loadcase3", "Loadcase4", "Loadcase5", "Loadcase6", "Loadcase7", "Loadcase8"])
num = Number([number_slider, Slider(2, range=0..10), Slider(3, range=0..10), Slider(4, range=0..10), Slider(5, range=0..10), Slider(6, range=0..10), Slider(7, range=0..10), Slider(8, range=0..10)])
loadcase = Loadcase(
    Name=txt,
    Number=num,
    Nature="{ \"_t\" : \"System.Enum\", \"TypeName\" : { \"_t\" : \"System.Type\", \"Name\" : \"BH.oM.Structure.Loads.LoadNature\" }, \"Value\" : \"Other\" }",
    Component="{ .Loadcase")

# ----
# Push
toggle = BooleanToggle(False)
bhom_2 = BHoMObject(loadcase)
push = Push(Adapter=bhom, Objects=bhom_2, Active=toggle, Component="{ .Push")  # -> Objects, Success

bhom_3 = BHoMObject(push.Objects)

# ----
# Create BHoM Object
panel = Panel("Load Combination_1")
loadcombination = LoadCombination(
    Name=panel,
    Number=Slider(100, range=0..100),
    Cases=bhom_3,
    Factors=[Slider(1.35, range=0..10), Slider(2, range=0..10), Slider(1.2, range=0..10), Slider(1.1, range=0..10), Slider(1.7, range=0..10), Slider(2.5, range=0..10), Slider(1.1, range=0..10), Slider(1, range=0..10)],
    ExcludeZeroFactorCases=True,
    Component="{ .LoadCombination")

# ----
# Push
bhom_4 = BHoMObject(loadcombination)
push_2 = Push(Adapter=bhom, Objects=bhom_4, Active=push.Success, Component="{ .Push")  # -> Objects, Success
