# Grasshopper definition CreatePointLoads.gh (Grasshopper 0.9.76)
# plug-ins: BH.UI.Grasshopper

# ----
# Adapter
path = FilePath()
bhom = BHoMObject()

# ----
# Create Loadcase
panel = Panel("Loadcase1")
loadcase = Loadcase(
    Name=panel,
    Number=Slider(1, range=0..10),
    Nature="{ \"_t\" : \"System.Enum\", \"TypeName\" : { \"_t\" : \"System.Type\", \"Name\" : \"BH.oM.Structure.Loads.LoadNature\" }, \"Value\" : \"Other\" }",
    Component="{ .Loadcase")

# ----
# Push
toggle = BooleanToggle(False)
bhom_2 = BHoMObject([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])
push = Push(Adapter=bhom, Objects=bhom_2, Active=toggle, Component="{ .Push")  # -> Objects, Success

bhom_3 = BHoMObject(loadcase)
bhom_4 = BHoMObject(push.Objects)

# ----
# Create BHoM Load
number_slider = Slider(2, range=0..10)
vec = VectorXYZ(XComponent=Slider(7, range=0..10), YComponent=Slider(3, range=0..10), ZComponent=Slider(6, range=0..10))  # -> Vector, Length
vec_2 = VectorXYZ(XComponent=number_slider, YComponent=Slider(6, range=0..10), ZComponent=Slider(8, range=0..10))  # -> Vector, Length
vec_3 = Vector(vec_2.Vector)
loadaxis = LoadAxis(
    {"Global": 0, "Local": 1}, selected="Global",
    TypeName="BH.oM.Structure.Loads.LoadAxis, Structure_oM, Version=2.0.0.0, Culture=neutral, PublicKeyToken=null")
vec_4 = Vector(vec.Vector)

pointload = PointLoad(Loadcase=bhom_3, Group=bhom_4, Force=vec_3, Moment=vec_4, Axis=loadaxis, Name="PointLoad", Component="{ .PointLoad")

# ----
# Push
bhom_5 = BHoMObject(pointload)
push_2 = Push(Adapter=bhom, Objects=bhom_5, Active=push.Success, Component="{ .Push")  # -> Objects, Success
