# Grasshopper definition Truss_Model.gh (Grasshopper 0.9.76)
# plug-ins: BH.UI.Grasshopper

# ----
# Create Material
number_slider = Slider(2.5, range=0..10)
material = Material(
    Name="Steel",
    Type="{ \"_t\" : \"System.Enum\", \"TypeName\" : { \"_t\" : \"System.Type\", \"Name\" : \"BH.oM.Common.Materials.MaterialType\" }, \"Value\" : \"Steel\" }",
    E=Slider(33000000, range=0..100000000),
    V=Slider(0.3, range=0..1),
    TC=1.2e-05,
    Density=number_slider,
    Component="{ .Material")

# ----
# Adapter
path = FilePath("C:\Users\pnugent\Desktop\wgsdgh.mdl")

bhom = BHoMObject()
bhom_2 = BHoMObject(material)

# ----
# Create Section Property
panel = Panel("500x500x30 SHS")
bhom_3 = BHoMObject(bhom_2)
bhom_4 = BHoMObject(bhom_2)
number_slider_2 = Slider(0.5, range=0..1)
steelboxsection = SteelBoxSection(
    Height=number_slider_2,
    Width=number_slider_2,
    Thickness=Slider(0.03, range=0..0.1),
    InnerRadius=0,
    OuterRadius=0,
    Material=bhom_3,
    Name=panel,
    Component="{ .SteelBoxSection")
steeltubesection = SteelTubeSection(
    Diameter=Slider(0.15, range=0..1),
    Thickness=Slider(0.02, range=0..0.1),
    Material=bhom_4,
    Name="150x20 CHS",
    Component="{ .SteelTubeSection")

bhom_5 = BHoMObject(steelboxsection)
bhom_6 = BHoMObject(steeltubesection)

# ----
# Create Constraints
toggle = BooleanToggle(False)
toggle_2 = BooleanToggle(False)
toggle_3 = BooleanToggle(True)
constraint6dof = Constraint6DOF(X=toggle, Y=toggle, Z=toggle, Xx=toggle, Yy=Toggle(True), Zz=toggle, Name="Pin", Component="{ .Constraint6DOF")
constraint6dof_2 = Constraint6DOF(X=toggle_3, Y=toggle_2, Z=toggle_2, Xx=toggle_2, Yy=toggle_3, Zz=toggle_2, Name="Roller", Component="{ .Constraint6DOF")

barreleasefixfix = BarReleaseFixFix(Name="FixFix", Component="{ .BarReleaseFixFix")
barreleasefixfix_2 = BarReleaseFixFix(Name="FixFix", Component="{ .BarReleaseFixFix")
barreleasefixfix_3 = BarReleaseFixFix(Name="FixFix", Component="{ .BarReleaseFixFix")

# ----
# Create Bars
barfeatype = BarFEAType(
    {"Flexural": 0, "Axial": 1, "CompressionOnly": 2, "TensionOnly": 3}, selected="Flexural",
    Component="{ \"_t\" : \"System.Type\", \"Name\" : \"BH.oM.Structure.Elements.BarFEAType\" }",
    Selection=0)
barfeatype_2 = BarFEAType(
    {"Flexural": 0, "Axial": 1, "CompressionOnly": 2, "TensionOnly": 3}, selected="Flexural",
    Component="{ \"_t\" : \"System.Type\", \"Name\" : \"BH.oM.Structure.Elements.BarFEAType\" }",
    Selection=0)
barfeatype_3 = BarFEAType(
    {"Flexural": 0, "Axial": 1, "CompressionOnly": 2, "TensionOnly": 3}, selected="Axial",
    Component="{ \"_t\" : \"System.Type\", \"Name\" : \"BH.oM.Structure.Elements.BarFEAType\" }",
    Selection=1)
line = Line([Line((0, 0, 2), (3.48066779, 0, 2.619002167)), Line((3.48066779, 0, 2.619002167), (7.835801315, 0, 3.160455225)), Line((7.835801315, 0, 3.160455225), (12.83141828, 0, 3.468952405)), Line((12.83141828, 0, 3.468952405), (18.03700537, 0, 3.439094977)), Line((18.03700537, 0, 3.439094977), (22.95069632, 0, 3.08159316)), Line((22.95069632, 0, 3.08159316), (27.16891284, 0, 2.516169223)), Line((27.16891284, 0, 2.516169223), (30, 0, 2))])
bhom_7 = BHoMObject(bhom_5)
bhom_8 = BHoMObject(bhom_5)
line_2 = Line([Line((0, 0, 0), (0, 0, 2)), Line((0, 0, 2), (1.5071081, 0, 0)), Line((1.5071081, 0, 0), (3.48066779, 0, 2.619002167)), Line((3.48066779, 0, 2.619002167), (5.45422748, 0, 0)), Line((5.45422748, 0, 0), (7.835801315, 0, 3.160455225)), Line((7.835801315, 0, 3.160455225), (10.21737515, 0, 0))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])
line_3 = Line([Line((0, 0, 0), (1.5071081, 0, 0)), Line((1.5071081, 0, 0), (5.45422748, 0, 0)), Line((5.45422748, 0, 0), (10.21737515, 0, 0)), Line((10.21737515, 0, 0), (15.44546142, 0, 0)), Line((15.44546142, 0, 0), (20.62854932, 0, 0)), Line((20.62854932, 0, 0), (25.27284333, 0, 0)), Line((25.27284333, 0, 0), (29.06498235, 0, 0)), Line((29.06498235, 0, 0), (30, 0, 0))])
bar = Bar(Line=line, Property=bhom_7, OrientationAngle=0, Release=barreleasefixfix_2, FeaType=barfeatype, Component="{ .Bar")
bar_2 = Bar(Line=line_3, Property=bhom_8, OrientationAngle=0, Release=barreleasefixfix, FeaType=barfeatype_2, Component="{ .Bar")
bar_3 = Bar(Line=line_2, Property=bhom_6, OrientationAngle=0, Release=barreleasefixfix_3, FeaType=barfeatype_3, Component="{ .Bar")

bhom_9 = BHoMObject(constraint6dof)
bhom_10 = BHoMObject(constraint6dof_2)
bhom_11 = BHoMObject(bar)
bhom_12 = BHoMObject(bar_2)
bhom_13 = BHoMObject(bar_3)

# ----
# Create Nodes
pt = Point([Point(0, 0, 0), Point(0, 0, 2), Point(1.5071081, 0, 0), Point(3.48066779, 0, 2.619002167), Point(5.45422748, 0, 0), Point(7.835801315, 0, 3.160455225), Point(10.21737515, 0, 0), Point(12.83141828, 0, 3.468952405), Point(15.44546142, 0, 0), Point(18.03700537, 0, 3.439094977), Point(20.62854932, 0, 0), Point(22.95069632, 0, 3.08159316), Point(25.27284333, 0, 0), Point(27.16891284, 0, 2.516169223), Point(29.06498235, 0, 0), Point(30, 0, 2), Point(30, 0, 0)])
rev = ReverseList(List=pt)
item = ListItem(List=pt, Index=0, Wrap=True)
item_2 = ListItem(List=rev, Index=0, Wrap=True)
node = Node(Position=item, Constraint=bhom_9, Component="{ .Node")
node_2 = Node(Position=item_2, Constraint=bhom_10, Component="{ .Node")

# ----
# Assign Tags
panel_2 = Panel("Tags")
panel_3 = Panel("""Top Chord
S355""")
panel_4 = Panel("""Bottom Chord
S355""")
panel_5 = Panel("""Bracing
S355
Wind Loaded""")
propertyvalue = PropertyValue(Obj=bhom_12, PropName=panel_2, Value=panel_4, Component="{ .PropertyValue")
propertyvalue_2 = PropertyValue(Obj=bhom_13, PropName="Tags", Value=panel_5, Component="{ .PropertyValue")

propertyvalue_3 = PropertyValue(Obj=bhom_11, PropName="Tags", Value=panel_3, Component="{ .PropertyValue")
bhom_14 = BHoMObject(propertyvalue_3)
bhom_15 = BHoMObject(propertyvalue)
bhom_16 = BHoMObject(propertyvalue_2)
bhom_17 = BHoMObject(node_2)
bhom_18 = BHoMObject(node)
bhom_19 = BHoMObject([bhom_18, bhom_17])

# ----
# Push
toggle_4 = BooleanToggle(False)
push = Push(Adapter=bhom, Objects=bhom_19, Active=toggle_4, Component="{ .Push")  # -> Objects, Success

bhom_20 = BHoMObject([bhom_14, bhom_15, bhom_16])

# ----
# Create Mesh
split1d = Split1D(
    {"Divisions": 0, "Length": 1, "Automatic": 2}, selected="Divisions",
    TypeName="BH.oM.Adapters.Lusas.Split1D, Lusas_oM, Version=2.0.0.0, Culture=neutral, PublicKeyToken=null")
meshsettings1d = MeshSettings1D(SplitMethod=split1d, SplitParameter=Slider(10, range=0..10), Name="Bar Mesh", Component="{ .MeshSettings1D")
c_script = CSharpScript(x="Mesh", y=meshsettings1d)  # -> out, A; inputs x: String
# ---------- c_script: C# ----------
    A = new GH_ObjectWrapper(new Dictionary<string,object>(){{x,y}});
# ---------- end c_script ----------
propertyvalue_4 = PropertyValue(Obj=flatten(bhom_20), PropName="CustomData", Value=c_script.A, Component="{ .PropertyValue")

# ----
# Push
bhom_21 = BHoMObject(propertyvalue_4)
push_2 = Push(Adapter=bhom, Objects=bhom_21, Active=push.Success, Component="{ .Push")  # -> Objects, Success

# ----
# Create Loadcases
panel_6 = Panel("Live Load")
number_slider_3 = Slider(0, range=0..100)
loadcase = Loadcase(
    Name="Gravity",
    Number=number_slider_3,
    Nature="{ \"_t\" : \"System.Enum\", \"TypeName\" : { \"_t\" : \"System.Type\", \"Name\" : \"BH.oM.Structure.Loads.LoadNature\" }, \"Value\" : \"Other\" }",
    Component="{ .Loadcase")
loadcase_2 = Loadcase(
    Name=panel_6,
    Number=number_slider_3,
    Nature="{ \"_t\" : \"System.Enum\", \"TypeName\" : { \"_t\" : \"System.Type\", \"Name\" : \"BH.oM.Structure.Loads.LoadNature\" }, \"Value\" : \"Other\" }",
    Component="{ .Loadcase")
loadcase_3 = Loadcase(
    Name="Wind",
    Number=number_slider_3,
    Nature="{ \"_t\" : \"System.Enum\", \"TypeName\" : { \"_t\" : \"System.Type\", \"Name\" : \"BH.oM.Structure.Loads.LoadNature\" }, \"Value\" : \"Other\" }",
    Component="{ .Loadcase")

explode = Explode(Object=bhom_21, Component="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")  # -> StartNode, EndNode, SectionProperty, OrientationAngle, Release, FEAType, Spring, Offset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

# ----
# Push
bhom_22 = BHoMObject([loadcase, loadcase_3, loadcase_2])
push_3 = Push(Adapter=bhom, Objects=bhom_22, Active=push_2.Success, Component="{ .Push")  # -> Objects, Success

# ----
# Filter Bars by Tags
txt = Text(explode.Tags)
txt_2 = Text(txt)
txt_3 = Text(txt)
c_script_2 = CSharpScript(Tags=txt_3, Filter="Wind Loaded")  # -> out, Indices; inputs Tags: tree of String, Filter: list of String
# ---------- c_script_2: C# ----------
    DataTree<int> matches = new DataTree<int>();

    for (int t = 0; t < Filter.Count; t++)
    {
      for (int i = 0; i < Tags.BranchCount; i++)
      {
        for (int j = 0; j < Tags.Branch(i).Count; j++)
        {
          if (Tags.Branch(i)[j] == Filter[t])
          {
            GH_Path pth = new GH_Path(t);
            matches.Add(i, pth);
          }
        }
      }
    }

    Indices = matches;
# ---------- end c_script_2 ----------
c_script_3 = CSharpScript(Tags=txt_2, Filter="Bottom Chord")  # -> out, Indices; inputs Tags: tree of String, Filter: list of String; same code as c_script_2
bhom_23 = BHoMObject(push_2.Objects)
bhom_24 = BHoMObject(push_2.Objects)
item_3 = ListItem(List=flatten(bhom_23), Index=c_script_3.Indices, Wrap=True)
item_4 = ListItem(List=flatten(bhom_24), Index=c_script_2.Indices, Wrap=True)

bhom_25 = BHoMObject(push_3.Objects)
item_5 = ListItem(List=bhom_25, Index=0, Wrap=True)  # -> Item, Item1, Item2

# ----
# Create BHoM Loads
bhom_26 = BHoMObject(push_2.Objects)
bhom_27 = BHoMObject(item_3)
bhom_28 = BHoMObject(item_4)
bhom_29 = BHoMObject(item_5.Item)
vec = Vector(Vector(0, 0, -1))
bhom_30 = BHoMObject(item_5.Item1)
vec_2 = Vector(Vector(0, 0, -10))
bhom_31 = BHoMObject(item_5.Item2)
vec_3 = Vector(Vector(5, 0, 0))
baruniformlydistributedload = BarUniformlyDistributedLoad(
    Loadcase=bhom_30,
    Objects=bhom_27,
    Force=vec_2,
    Axis="{ \"_t\" : \"System.Enum\", \"TypeName\" : { \"_t\" : \"System.Type\", \"Name\" : \"BH.oM.Structure.Loads.LoadAxis\" }, \"Value\" : \"Global\" }",
    Projected=False,
    Name="Pedestrian Load",
    Component="{ .BarUniformlyDistributedLoad")
baruniformlydistributedload_2 = BarUniformlyDistributedLoad(
    Loadcase=bhom_31,
    Objects=bhom_28,
    Force=vec_3,
    Axis="{ \"_t\" : \"System.Enum\", \"TypeName\" : { \"_t\" : \"System.Type\", \"Name\" : \"BH.oM.Structure.Loads.LoadAxis\" }, \"Value\" : \"Global\" }",
    Projected=False,
    Name="Wind Load",
    Component="{ .BarUniformlyDistributedLoad")
gravityload = GravityLoad(Loadcase=bhom_29, Direction=vec, Objects=bhom_26, Name="Gravity", Component="{ .GravityLoad")

bhom_32 = BHoMObject([gravityload, baruniformlydistributedload, baruniformlydistributedload_2])

# ----
# Push
push_4 = Push(Adapter=bhom, Objects=bhom_32, Active=push_3.Success, Component="{ .Push")  # -> Objects, Success

# ----
# Create Load Combination
panel_7 = Panel("LC 1")
panel_8 = Panel("""1.35
1.35
1""")
loadcombination = LoadCombination(
    Name=panel_7,
    Number=Slider(0, range=0..100),
    Cases=flatten(bhom_25),
    Factors=panel_8,
    ExcludeZeroFactorCases=True,
    Component="{ .LoadCombination")

bhom_33 = BHoMObject(loadcombination)

# ----
# Push
push_5 = Push(Adapter=bhom, Objects=bhom_33, Active=push_4.Success, Component="{ .Push")  # -> Objects, Success
