# Grasshopper definition CreateConstraint4DOF.gh (Grasshopper 0.9.76)
# plug-ins: BH.UI.Grasshopper

# ----
# Adapter
path = FilePath()
bhom = BHoMObject()

# ----
# Create BHoM Object
number_slider = Slider(0, range=0..100)
constraint4dof = Constraint4DOF(
    TranslationX=Toggle(False),
    TranslationY=Toggle(False),
    TranslationZ=Toggle(False),
    RotationX=Toggle(False),
    TranslationalStiffnessX=Slider(0, range=0..100),
    TranslationalStiffnessY=number_slider,
    TranslationalStiffnessZ=Slider(0, range=0..100),
    RotationalStiffnessX=Slider(0, range=0..100),
    Name="Bar_Support",
    Component="{ \"_t\" : \"System.Type\", \"Name\" : \"BH.oM.Structure.Properties.Constraint.Constraint4DOF\" }")

# ----
# Push
toggle = BooleanToggle(False)
bhom_2 = BHoMObject(constraint4dof)
push = Push(Adapter=bhom, Objects=bhom_2, Active=toggle, Component="{ .Push")  # -> Objects, Success
