# Grasshopper definition CreateConstraint6DOF.gh (Grasshopper 0.9.76)
# plug-ins: BH.UI.Grasshopper

# ----
# Adapter
path = FilePath()
bhom = BHoMObject()

# ----
# Create BHoM Object
panel = Panel("Fixed Support")
constraint6dof = Constraint6DOF(
    X=Toggle(True),
    Y=Toggle(True),
    Z=Toggle(True),
    Xx=Toggle(True),
    Yy=Toggle(True),
    Zz=Toggle(True),
    Name=panel,
    Component="{ .Constraint6DOF")

# ----
# Push
bhom_2 = BHoMObject(constraint6dof)
push = Push(Adapter=bhom, Objects=bhom_2, Active=Toggle(False), Component="{ .Push")  # -> Objects, Success
