# Grasshopper definition CreateAngleSection.gh (Grasshopper 0.9.76)
# plug-ins: Alligator

# ----
# Create Adapter Here
# File Path to reference model file
# Plug structural adapter in to this component.
path = FilePath("C:\Users\pnugent\Desktop\wgsdgh.mdl")

bhom = BHoMObject()

# ----
# Create AngleSection
number_slider = Slider(0.9, range=0..2)

steelanglesection = SteelAngleSection(
    Height=Slider(1.6, range=0..2),
    WebThickness=Slider(0.01, range=0..0.1),
    Width=number_slider,
    FlangeThickness=Slider(0.03, range=0..0.1),
    RootRadius=0,
    ToeRadius=0,
    Name="Angle Section",
    Component="{ .SteelAngleSection")
bhom_2 = BHoMObject(steelanglesection)
push = Push(Adapter=bhom, Objects=bhom_2, Active=Toggle(False), Component="{ .Push")  # -> Objects, Success
