# Grasshopper definition CreateBoxSection.gh (Grasshopper 0.9.76)
# plug-ins: Alligator

# ----
# Create Adapter Here
# File Path to reference model file
# Plug structural adapter in to this component.
path = FilePath("C:\Users\pnugent\Desktop\wgsdgh.mdl")

bhom = BHoMObject()

# ----
# Create BoxSection
number_slider = Slider(0.02, range=0..0.1)

steelboxsection = SteelBoxSection(
    Height=Slider(1.2, range=0..2),
    Width=Slider(0.6, range=0..2),
    Thickness=number_slider,
    InnerRadius=0,
    OuterRadius=0,
    Name="Box Section",
    Component="{ .SteelBoxSection")
bhom_2 = BHoMObject(steelboxsection)
push = Push(Adapter=bhom, Objects=bhom_2, Active=Toggle(False), Component="{ .Push")  # -> Objects, Success
