# Grasshopper definition CreateChannelSection.gh (Grasshopper 0.9.76)
# plug-ins: Alligator

# ----
# Create Adapter Here
# File Path to reference model file
# Plug structural adapter in to this component.
path = FilePath("C:\Users\pnugent\Desktop\wgsdgh.mdl")

bhom = BHoMObject()

# ----
# Create ChannelSection
number_slider = Slider(0.03, range=0..0.1)

channelprofile = ChannelProfile(
    Height=Slider(1, range=0..2),
    Width=Slider(0.3, range=0..2),
    Webthickness=Slider(0.02, range=0..0.1),
    FlangeThickness=number_slider,
    RootRadius=Slider(0, range=0..0.1),
    ToeRadius=Slider(0, range=0..0.1),
    MirrorAboutLocalZ=Toggle(False),
    Component="{ .ChannelProfile")
bhom_2 = BHoMObject(channelprofile)

steelsectionfromprofile = SteelSectionFromProfile(Profile=[channelprofile, bhom_2], Name="Channel Section", Component="{ .SteelSectionFromProfile")

bhom_3 = BHoMObject(steelsectionfromprofile)
push = Push(Adapter=bhom, Objects=bhom_3, Active=Toggle(False), Component="{ .Push")  # -> Objects, Success
