# Grasshopper definition CreateCircularSection.gh (Grasshopper 0.9.76)
# plug-ins: Alligator

# ----
# Create Adapter Here
# File Path to reference model file
# Plug structural adapter in to this component.
path = FilePath("C:\Users\pnugent\Desktop\wgsdgh.mdl")

bhom = BHoMObject()

# ----
# Create CircularSection
number_slider = Slider(0.9, range=0..2)

steelcircularsection = SteelCircularSection(Diameter=number_slider, Name="Circular Section", Component="{ .SteelCircularSection")
bhom_2 = BHoMObject(steelcircularsection)
push = Push(Adapter=bhom, Objects=bhom_2, Active=Toggle(False), Component="{ .Push")  # -> Objects, Success
