# Grasshopper definition CreateFabricatedBoxSection.gh (Grasshopper 0.9.76)
# plug-ins: BH.UI.Grasshopper

# ----
# Adapter
path = FilePath()
bhom = BHoMObject()

# ----
# Create Profile
number_slider = Slider(0.07, range=0..0.1)
panel = Panel("Fabricated Box")
fabricatedboxprofile = FabricatedBoxProfile(
    Height=Slider(2, range=0..2),
    Width=Slider(1.2, range=0..2),
    WebThickness=Slider(0.02, range=0..0.1),
    TopFlangeThickness=number_slider,
    BotFlangeThickness=number_slider,
    WeldSize=Slider(0, range=0..0.1),
    Component="{ .FabricatedBoxProfile")

bhom_2 = BHoMObject(fabricatedboxprofile)

# ----
# Create Steel Section
steelsectionfromprofile = SteelSectionFromProfile(Profile=bhom_2, Name="Fabricated Box Section", Component="{ .SteelSectionFromProfile")

# ----
# Push
toggle = BooleanToggle(False)
bhom_3 = BHoMObject(steelsectionfromprofile)
push = Push(Adapter=bhom, Objects=bhom_3, Active=toggle, Component="{ .Push")  # -> Objects, Success
