# Grasshopper definition CreateFabricatedISection.gh (Grasshopper 0.9.76)
# plug-ins: Alligator

# ----
# Create Adapter Here
# File Path to reference model file
# Plug structural adapter in to this component.
path = FilePath("C:\Users\pnugent\Desktop\wgsdgh.mdl")

bhom = BHoMObject()

# ----
# Create FabricatedISection
number_slider = Slider(0.02, range=0..0.1)
steelfabricatedisection = SteelFabricatedISection(
    Height=Slider(1.3, range=0..2),
    WebThickness=Slider(0.06, range=0..0.1),
    TopFlangeWidth=Slider(0.7, range=0..2),
    TopFlangeThickness=number_slider,
    BotFlangeWidth=Slider(1.3, range=0..2),
    BotFlangeThickness=Slider(0.02, range=0..0.1),
    WeldSize=Slider(0, range=0..0.1),
    Name="Fabricated I Section",
    Component="{ .SteelFabricatedISection")

bhom_2 = BHoMObject(steelfabricatedisection)
push = Push(Adapter=bhom, Objects=bhom_2, Active=Toggle(False), Component="{ .Push")  # -> Objects, Success
