# Grasshopper definition CreateGeneralisedFabricatedBoxSection.gh (Grasshopper 0.9.76)
# plug-ins: Alligator

# ----
# Create Adapter Here
# File Path to reference model file
# Plug structural adapter in to this component.
path = FilePath("C:\Users\pnugent\Desktop\wgsdgh.mdl")

bhom = BHoMObject()

# ----
# Create GeneralisedFabricatedBoxSection
number_slider = Slider(0.03, range=0..0.1)
generalisedfabricatedboxprofile = GeneralisedFabricatedBoxProfile(
    Height=Slider(1.1, range=0..2),
    Width=Slider(0.6, range=0..2),
    WebThickness=Slider(0.01, range=0..0.1),
    TopFlangeThickness=number_slider,
    BotFlangeThickness=Slider(0.03, range=0..0.1),
    TopCorbelWidth=Slider(0.1, range=0..0.1),
    BotCorbelWidth=Slider(0.08, range=0..0.1),
    Component="{ .GeneralisedFabricatedBoxProfile")
steelsectionfromprofile = SteelSectionFromProfile(Profile=generalisedfabricatedboxprofile, Name="FabricatedBoxProfile", Component="{ .SteelSectionFromProfile")

bhom_2 = BHoMObject(steelsectionfromprofile)
push = Push(Adapter=bhom, Objects=bhom_2, Active=Toggle(False), Component="{ .Push")  # -> Objects, Success
