# Grasshopper definition CreateRectangleSection.gh (Grasshopper 0.9.76)
# plug-ins: Alligator

# ----
# Create Adapter Here
# File Path to reference model file
# Plug structural adapter in to this component.
path = FilePath("C:\Users\pnugent\Desktop\wgsdgh.mdl")

bhom = BHoMObject()

# ----
# Create RectangleSection
number_slider = Slider(1.1, range=0..2)
steelrectanglesection = SteelRectangleSection(
    Height=number_slider,
    Width=Slider(0.6, range=0..2),
    CornerRadius=0,
    Name="Rectangle Section",
    Component="{ .SteelRectangleSection")

bhom_2 = BHoMObject(steelrectanglesection)
push = Push(Adapter=bhom, Objects=bhom_2, Active=Toggle(False), Component="{ .Push")  # -> Objects, Success
