# Grasshopper definition CreateTSection.gh (Grasshopper 0.9.76)
# plug-ins: Alligator

# ----
# Create Adapter Here
# File Path to reference model file
# Plug structural adapter in to this component.
path = FilePath("C:\Users\pnugent\Desktop\wgsdgh.mdl")

bhom = BHoMObject()

# ----
# Create TSection
number_slider = Slider(0.02, range=0..0.1)
steeltsection = SteelTSection(
    Height=Slider(1, range=0..2),
    WebThickness=Slider(0.02, range=0..0.1),
    FlangeWidth=Slider(1.3, range=0..2),
    FlangeThickness=number_slider,
    RootRadius=0,
    ToeRadius=0,
    Name="T Section",
    Component="{ .SteelTSection")

bhom_2 = BHoMObject(steeltsection)
push = Push(Adapter=bhom, Objects=bhom_2, Active=Toggle(False), Component="{ .Push")  # -> Objects, Success
