# Grasshopper definition CreateTubeSection.gh (Grasshopper 0.9.76)
# plug-ins: Alligator

# ----
# Create Adapter Here
# File Path to reference model file
# Plug structural adapter in to this component.
path = FilePath("C:\Users\pnugent\Desktop\wgsdgh.mdl")

bhom = BHoMObject()

# ----
# Create TubeSection
number_slider = Slider(0.02, range=0..0.1)

steeltubesection = SteelTubeSection(Diameter=Slider(1, range=0..2), Thickness=number_slider, Name="Tube Section", Component="{ .SteelTubeSection")
push = Push(Adapter=bhom, Objects=steeltubesection, Active=Toggle(False), Component="{ .Push")  # -> Objects, Success
