# Grasshopper definition CreateConstantThickness.gh (Grasshopper 0.9.76)
# plug-ins: Alligator

# ----
# Create Adapter Here
# File Path to reference model file
# Plug structural adapter in to this component.
path = FilePath("C:\Users\pnugent\Desktop\wgsdgh.mdl")

bhom = BHoMObject()

# ----
# Create SurfaceProperty
number_slider = Slider(0.01, range=0..0.01)
constantthickness = ConstantThickness(Thickness=number_slider, Name="Constant_Thickness", Type=null, Component="{ .ConstantThickness")

bhom_2 = BHoMObject(constantthickness)
push = Push(Adapter=bhom, Objects=bhom_2, Active=Toggle(False), Component="{ .Push")  # -> Objects, Success
