# Grasshopper definition CreateLoadingPanel.gh (Grasshopper 0.9.76)
# plug-ins: Alligator

# ----
# Create Adapter Here
# File Path to reference model file
# Plug structural adapter in to this component.
path = FilePath("C:\Users\pnugent\Desktop\wgsdgh.mdl")

bhom = BHoMObject()

# ----
# Create LoadingPanel
loadingpanelproperty = LoadingPanelProperty(SupportCondition=null, ReferenceEdge=1, Component="{ .LoadingPanelProperty")

bhom_2 = BHoMObject(loadingpanelproperty)
push = Push(Adapter=bhom, Objects=bhom_2, Active=Toggle(False), Component="{ .Push")  # -> Objects, Success
