# Grasshopper definition CreateRibbedPanel.gh (Grasshopper 0.9.76)
# plug-ins: Alligator

# ----
# Create Adapter Here
# File Path to reference model file
# Plug structural adapter in to this component.
path = FilePath("C:\Users\pnugent\Desktop\wgsdgh.mdl")

bhom = BHoMObject()
paneldirection = PanelDirection(
    {"X": 0, "Y": 1}, selected="X",
    Component="{ \"_t\" : \"System.Type\", \"Name\" : \"BH.oM.Structure.Properties.Surface.PanelDirection\" }",
    Selection=0)

# ----
# Create Ribbed SurfaceProperty
number_slider = Slider(1.5, range=0..2)
ribbed = Ribbed(
    Name="Ribbed_Panel",
    SlabDepth=Slider(1.2, range=0..2),
    TotalDepth=Slider(2, range=0..2),
    StemWidth=number_slider,
    Spacing=Slider(1.8, range=0..2),
    Direction=paneldirection,
    Type=null,
    Component="{ .Ribbed")

bhom_2 = BHoMObject(ribbed)
push = Push(Adapter=bhom, Objects=bhom_2, Active=Toggle(False), Component="{ .Push")  # -> Objects, Success
