# Grasshopper definition CreateWaffleThickness.gh (Grasshopper 0.9.76)
# plug-ins: BH.UI.Grasshopper

# ----
# Adapter
path = FilePath()
bhom = BHoMObject(m_ForcePreview=False, m_MaxItemsPreview=10000)

# ----
# Create Waffle Thickness
number_slider = Slider(1, range=0..2)
waffle = Waffle(
    Name="Waffle",
    SlabDepth=Slider(1.3, range=0..2),
    DepthX=Slider(1.5, range=0..2),
    DepthY=Slider(1.7, range=0..2),
    StemWidthX=number_slider,
    StemWidthY=Slider(1.2, range=0..2),
    SpacingX=Slider(1.5, range=0..2),
    SpacingY=Slider(1.5, range=0..2),
    Type=null,
    Component="{ .Waffle")

# ----
# Push
toggle = BooleanToggle(False)
push = Push(Adapter=bhom, Objects=waffle, Active=toggle, Component="{ .Push")  # -> Objects, Success
