# Grasshopper definition Bars-with-properties.gh (Grasshopper 0.9.76)
# plug-ins: BH.UI.Grasshopper

# ----
# Adapter
path = FilePath()
bhom = BHoMObject()

# ----
# Create Material
panel = Panel("Steel")
materialtype = MaterialType(
    {"Aluminium": 0, "Steel": 1, "Concrete": 2, "Timber": 3, "Rebar": 4, "Tendon": 5, "Glass": 6, "Cable": 7}, selected="Steel",
    Component="{ \"_t\" : \"System.Type\", \"Name\" : \"BH.oM.Common.Materials.MaterialType\" }",
    Selection=1)
material = Material(Name=panel, Type=materialtype, E=2.1e+11, V=0.3, TC=1.2e-05, Density=7850, Component="{ .Material")

bhom_2 = BHoMObject(material)

# ----
# Create Section
number_slider = Slider(0.5, range=0..1)
steelboxsection = SteelBoxSection(
    Height=number_slider,
    Width=Slider(0.5, range=0..1),
    Thickness=Slider(0.03, range=0..1),
    InnerRadius=0,
    OuterRadius=0,
    Material=bhom_2,
    Component="{ .SteelBoxSection")

# ----
# Create Bar Release
panel_2 = Panel("Pin")
barreleasepinpin = BarReleasePinPin(Name=panel_2, Component="{ .BarReleasePinPin")

bhom_3 = BHoMObject(steelboxsection)
bhom_4 = BHoMObject(barreleasepinpin)

# ----
# Create Line
line = Line([Line((-1, -2, 0), (1, -2, 0)), Line((1, -2, 0), (1, 2, 0)), Line((1, 2, 0), (-1, 2, 0)), Line((-1, 2, 0), (-1, -2, 0))])
barfeatype = BarFEAType(
    {"Flexural": 0, "Axial": 1, "CompressionOnly": 2, "TensionOnly": 3}, selected="Flexural",
    Component="{ \"_t\" : \"System.Type\", \"Name\" : \"BH.oM.Structure.Elements.BarFEAType\" }",
    Selection=0)
bar = Bar(
    Line=line,
    Property=bhom_3,
    OrientationAngle=Slider(0, range=-180..180),
    Release=bhom_4,
    FeaType=barfeatype,
    Component="{ .Bar")

bhom_5 = BHoMObject(bar)

# ----
# Push Bars
toggle = BooleanToggle(False)
push = Push(Adapter=bhom, Objects=bhom_5, Active=toggle, Component="{ .Push")  # -> Objects, Success
