# Grasshopper definition Loadcases-and-combinations.gh (Grasshopper 0.9.76)
# plug-ins: BH.UI.Grasshopper

# ----
# Adapter
path = FilePath()
bhom = BHoMObject()

number_slider = Slider(1, range=0..1)
# Create Loadcase
panel = Panel("Loadcase 1")
series = Series(Start=number_slider, Step=number_slider, Count=Slider(4, range=0..10))
loadcase = Loadcase(
    Name=[panel, "Loadcase 2", "Loadcase 3", "Loadcase 4"],
    Number=series,
    Nature="{ \"_t\" : \"System.Enum\", \"TypeName\" : { \"_t\" : \"System.Type\", \"Name\" : \"BH.oM.Structure.Loads.LoadNature\" }, \"Value\" : \"Other\" }",
    Component="{ .Loadcase")

# ----
# Push Loadcase
toggle = BooleanToggle(False)
push = Push(Adapter=bhom, Objects=loadcase, Active=toggle)  # -> Objects, Success

loadcombination = LoadCombination(
    Name="Loadcombination 1",
    Number=Slider(5, range=0..5),
    Cases=push.Objects,
    Factors=[Slider(2, range=0..10), Slider(3, range=0..10), Slider(4, range=0..10), Slider(2, range=0..10)],
    ExcludeZeroFactorCases=True,
    Component="{ .LoadCombination")

# ----
# Push Load Combination
toggle_2 = BooleanToggle(False)
push_2 = Push(Adapter=bhom, Objects=loadcombination, Active=toggle_2)  # -> Objects, Success
