# Grasshopper definition Panels-with-properties.gh (Grasshopper 0.9.76)
# plug-ins: BH.UI.Grasshopper

# ----
# Adapter
path = FilePath()
bhom = BHoMObject()

# ----
# Create Material
materialtype = MaterialType(
    {"Aluminium": 0, "Steel": 1, "Concrete": 2, "Timber": 3, "Rebar": 4, "Tendon": 5, "Glass": 6, "Cable": 7}, selected="Steel",
    Component="{ \"_t\" : \"System.Type\", \"Name\" : \"BH.oM.Common.Materials.MaterialType\" }",
    Selection=1)
material = Material(
    Name="Steel",
    Type=materialtype,
    E=Slider(33000000, range=0..100000000),
    V=Slider(0.3, range=0..1),
    TC=1.2e-05,
    Density=Slider(2.5, range=0..10),
    Component="{ .Material")

bhom_2 = BHoMObject(material)

# ----
# Create Surface Property
number_slider = Slider(0.2, range=0..1)
multiplication = Multiplication(A=number_slider, B=Slider(1000, range=0..1000))
concat = Concatenate(FragmentA=multiplication, FragmentB="mm")
constantthickness = ConstantThickness(
    Thickness=number_slider,
    Material=bhom_2,
    Name=concat,
    Type="{ \"_t\" : \"System.Enum\", \"TypeName\" : { \"_t\" : \"System.Type\", \"Name\" : \"BH.oM.Structure.Properties.Surface.PanelType\" }, \"Value\" : \"Undefined\" }",
    Component="{ .ConstantThickness")

bhom_3 = BHoMObject(constantthickness)

# ----
# Create PanelPlanar
srf = Surface(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)
edges = BrepEdges(Brep=srf)  # -> Naked, Interior, NonManifold
join = JoinCurves(Curves=edges.Naked, Preserve=False)
panelplanar = PanelPlanar(Outlines=join, Property=bhom_3, Component="{ .PanelPlanar")

bhom_4 = BHoMObject(panelplanar)

# ----
# Push
toggle = BooleanToggle(False)
push = Push(Adapter=bhom, Objects=bhom_4, Active=toggle, Component="{ .Push")  # -> Objects, Success
