# Dynamo graph Pull - TasTBD.dyn (Dynamo 1.3.3.4111)

# note: Colour Coding Stategy

# group: Get Things
# note: Get Inputs from Revit etc.

# group: Chop / Change Things
# note: Managing List / Filter Lists etc

# group: Input Things
# note: User Inputs Required

# group: Calculate Things
# note: Calculations

# group: Export Things
# note: Export to external files / software

# group: See Things
# note: Dispay Outputs

# group: WIP Things
# note: Things still under progress

# group: Select Tas TBD
# note: Script Purpose:
# Pull data from Tas EDSL
# Version Information to create script:
# Dynamo 1.3.3.4111
# Revit 2018.8.3
# Date created: 14/12/2018
# Date updated: 14/12/2018
file_path = Filename(".\SAM_Live_2zones.tbd")

tasTBDAdapter = CreateAdapterComponent(file_path)

# group: Pull BuildingElements
createType = CreateTypeComponent()
boolean = BoolSelector(false)

filterQuery = CreateQueryComponent(createType)
pull = PullComponent(tasTBDAdapter, filterQuery, arg3=boolean)

# group: Select Tas TBD
file_path_2 = Filename(".\SAM_Live_2zones.tbd")

tasTBDAdapter_2 = CreateAdapterComponent(file_path_2)

# group: pull Spaces
createType_2 = CreateTypeComponent()
boolean_2 = BoolSelector(false)

filterQuery_2 = CreateQueryComponent(createType_2)
pull_2 = PullComponent(tasTBDAdapter_2, filterQuery_2, arg3=boolean_2)

# group: Select Tas TBD
file_path_3 = Filename(".\SAM_Live_2zones.tbd")

tasTBDAdapter_3 = CreateAdapterComponent(file_path_3)

# group: Constructions
createType_3 = CreateTypeComponent()
boolean_3 = BoolSelector(false)

filterQuery_3 = CreateQueryComponent(createType_3)
pull_3 = PullComponent(tasTBDAdapter_3, filterQuery_3, arg3=boolean_3)
