# Grasshopper definition Pull Revit - Push gbXML_01.gh (Grasshopper 0.9.76)
# plug-ins: BH.UI.Grasshopper

filterquery = FilterQuery(Type="BH.oM.Environment.Elements.Building", Component="{ .FilterQuery")

toggle = BooleanToggle(False)
revitadapter = RevitAdapter(Active=toggle, Component="{ ..ctor")
pull = Pull(Adapter=revitadapter, Query=filterquery, Active=toggle, Component="{ .Pull")

buildingelements = BuildingElements(BhomObjects=pull, Component="{ .BuildingElements")
buildings = Buildings(BhomObjects=pull, Component="{ .Buildings")
spaces = Spaces(BhomObjects=pull, Component="{ .Spaces")
levels = Levels(BhomObjects=pull, Component="{ .Levels")
stripopenings = StripOpenings(Elements=buildingelements, Component="{ .StripOpenings")
openings = Openings(Elements=buildingelements, Component="{ .Openings")
shadingelements = ShadingElements(Elements=buildingelements, Component="{ .ShadingElements")
uniquespacenames = UniqueSpaceNames(Elements=stripopenings, Component="{ .UniqueSpaceNames")
buildspace = BuildSpace(Elements=stripopenings, SpaceName=uniquespacenames, Component="{ .BuildSpace")
matchspaces = MatchSpaces(ElementsAsSpaces=buildspace, Spaces=spaces, Component="{ .MatchSpaces")
documentbuilder = DocumentBuilder(
    Building=buildings,
    ElementsAsSpaces=matchspaces,
    ShadingElements=shadingelements,
    Levels=levels,
    Openings=openings,
    Component="{ .DocumentBuilder")

xmladapter = XMLAdapter(
    XmlFileName="BHoMGrasshoper",
    XmlDirectoryPath="C:\Users\mdengusi\Documents\GitHub\samples\gbXML_Toolkit",
    ExportType="{ \"_t\" : \"System.Enum\", \"TypeName\" : { \"_t\" : \"System.Type\", \"Name\" : \"BH.oM.XML.Enums.ExportType\" }, \"Value\" : \"gbXMLTAS\" }",
    ExportDetail="{ \"_t\" : \"System.Enum\", \"TypeName\" : { \"_t\" : \"System.Type\", \"Name\" : \"BH.oM.XML.Enums.ExportDetail\" }, \"Value\" : \"Full\" }",
    Component="{ ..ctor")
push = Push(Adapter=xmladapter, Objects=documentbuilder, Active=Toggle(False), Component="{ .Push")  # -> Objects, Success
